# Grasshopper definition myTruss.gh (Grasshopper 1.0.7)
# plug-ins: FEM-Design

X = UnitX(Factor=1)
pt = Point(Point(0, 0, 0))
Z = UnitZ(Factor="3")
line = LineSDL(Start=pt, Direction=X, Length="12")
move = Move(Geometry=line, Motion=Z)  # -> Geometry, Transform
default = MaterialDatabaseDefault(CountryCode="S")  # -> SteelMaterial, ConcreteMaterial, TimberMaterial, ReinforcementMaterial, StratumMaterial, CustomMaterial
merge = Merge(Data1=line, Data2=move.Geometry)
default_2 = SectionDatabaseDefault()  # -> SteelSection, ConcreteSection, TimberSection, HollowCoreSection, CustomSection
divide = DivideCurve(Curve=merge, Count="5", Kinks=False)  # -> Points, Tangents, Parameters
flip = FlipMatrix(Data=divide.Points)
getmaterialbyname_index = MaterialGetMaterialByNameIndex(Materials=default.SteelMaterial, MaterialNameIndex="S235J0")
getsectionbyname_index = SectionGetSectionByNameIndex(Sections=default_2.SteelSection, SectionNameIndex="5")
pline = PolyLine(Vertices=divide.Points, Closed=False)
pline_2 = PolyLine(Vertices=flip, Closed=False)
explode = Explode(Curve=pline, Recursive=True)  # -> Segments, Vertices
end = EndPoints(Curve=merge)  # -> Start, End
construct = LoadCaseConstruct(Name="VERTICAL LOAD", Type="Ordinary", DurationClass="permanent")
Z_2 = UnitZ(Factor="-10")
pointsupport = PointSupport(Plane=[end.Start, end.End], Tx=True, Ty=True, Tz=True, Rx=True, Ry=True, Rz=True, Identifier="S")
beam = BarsBeam(Curve=pline_2, Material=getmaterialbyname_index, Section=getsectionbyname_index, OrientLCS=True, Identifier="B")
beam_2 = BarsBeam(Curve=explode.Segments, Material=getmaterialbyname_index, Section=getsectionbyname_index, OrientLCS=True, Identifier="B")
force = PointLoadForce(Point=divide.Points, Force=Z_2, LoadCase=construct)
construct_2 = LoadCombinationConstruct(Name="myCombo", Type="ultimate_ordinary", LoadCase=construct, Gamma="1.50")
create = LoadGroupCreate(
    Name="myGroup",
    Type=0,
    LoadCase=construct,
    StandardUnfavourableSafetyFactor="1.35",
    StandardFavourableSafetyFactor=1,
    AccidentalUnfavourableSafetyFactor=1,
    AccidentalFavourableSafetyFactor=1,
    LoadCaseRelationship=0,
    Xi="1.0",
    PotentiallyLeadingAction=1)
construct_3 = ModelConstruct(
    CountryCode="S",
    StructureElements=flatten([beam, beam_2, pointsupport]),
    Loads=flatten(force),
    LoadCases=construct,
    LoadCombinations=construct_2,
    LoadGroups=create)
define = CombDefine(
    NLEmaxiter=30,
    PLdefloadstep=20,
    PLminloadstep=2,
    Plmaxeqiter=30,
    NLSMohr=True,
    NLSinitloadstep=10,
    NLSminloadstep=10,
    NLSactiveelemratio=5,
    NLSplasticelemratio=5,
    CRloadstep=20,
    CRmaxiter=30,
    CRstifferror=2)
define_2 = AnalysisDefine(
    Comb=define,
    CalcCase=False,
    CalcCstage=False,
    CalcImpf=False,
    CalcComb=False,
    CalcGmax=False,
    CalcStab=False,
    CalcFreq=False,
    CalcSeis=False,
    CalcDesign=False,
    CalcFootfall=False,
    Elemfine=False,
    Diaphragm=False,
    PeakSmoothing=False)
define_3 = DesignDefine(AutoDesign=Toggle(True), Check=True, BasedOn=Toggle(False), ApplyChanges=False)
python = GhPythonScript()  # -> a
# ---------- python: Python ----------
__author__ = "MarcoPellegrinoKonsu"
__version__ = "2022.07.25"

import rhinoscriptsyntax as rs
import os
a = os.path.join(rs.DocumentPath(), "myTruss.struxml")
# ---------- end python ----------
open = ModelOpen(FdModel=construct_3, FilePathStruxml=python, CloseOpenWindows=False, RunNode=Toggle(False))
rundesign = ApplicationRunDesign(
    Mode="steel",
    Model=construct_3,
    FilePathStruxml=python,
    Analysis=define_2,
    Design=define_3,
    EndSession=Toggle(False),
    CloseOpenWindows=True,
    RunNode=Toggle(False))  # -> Model, FiniteElement, Results, HasExited
