# Grasshopper definition Example 9 - ReadResults.gh (Grasshopper 1.0.7)
# plug-ins: FEM-Design

# ----
# Use 'ResultsType' value list component
# to select the result to be returned.
# NOTE
# The results can be extracted if the model has been analysed.
# FEM-design will generate an ".strFEM" file from which we will read the results.
python = GhPythonScript()  # -> out, folder
# ---------- python: Python ----------
__author__ = "MarcoPellegrinoKonsu"
__version__ = "2022.06.30"

import rhinoscriptsyntax as rs

folder = rs.DocumentPath()
# ---------- end python ----------
resultstype = ResultsType({"NodalDisplacement", "PointSupportReaction", "BarDisplacement", "BarInternalForce", "BarStress", "LineSupportReaction", "ShellDisplacement", "ShellInternalForce", "ShellStress", "LabelledSectionInternalForce", "LabelledSectionResultant", "NodalVibrationShape", "EigenFrequencies", "QuantityEstimationConcrete", "QuantityEstimationSteel", "QuantityEstimationTimber", "QuantityEstimationTimberPanel", "QuantityEstimationGeneral", "QuantityEstimationReinforcement"}, selected="NodalDisplacement")
str_file = Panel("myModel.str")
concat = Concatenate(FragmentA=python.folder, FragmentB=str_file)
path = FilePath(concat)
readstr = ModelReadStr(StrPath=path, ResultTypes=resultstype, RunNode=True)  # -> FdModel, FdFeaModel, Results
nodaldisplacement = NodalDisplacement(Result=readstr.Results, CaseCombinationName="SELF WEIGHT")  # -> CaseIdentifier, NodeId, Translation, Rotation

panel = Panel("myModel.str")  # disabled
resultstype_2 = ResultsType({"NodalDisplacement", "PointSupportReaction", "PointSupportReactionMinMax", "BarDisplacement", "BarInternalForce", "BarStress", "LineSupportReaction", "ShellDisplacement", "ShellInternalForce", "ShellStress", "LabelledSectionInternalForce", "LabelledSectionResultant", "NodalVibrationShape", "EigenFrequencies", "QuantityEstimationConcrete", "QuantityEstimationSteel", "QuantityEstimationTimber", "QuantityEstimationTimberPanel", "QuantityEstimationGeneral", "QuantityEstimationReinforcement"}, selected=["NodalDisplacement", "PointSupportReaction"])  # disabled
# Selecting more than one ResultType will generate a
# DataTree structure in the 'Results' output.
# You can use 'BANG' or 'Branch' to select the desire result.
python_2 = GhPythonScript()  # -> out, folder; disabled; same code as python
concat_2 = Concatenate(FragmentA=python_2.folder, FragmentB=panel)  # disabled
path_2 = FilePath(concat_2)  # disabled
readstr_2 = ModelReadStr(StrPath=path_2, ResultTypes=resultstype_2, RunNode=True)  # -> FdModel, FdFeaModel, Results; disabled
bang = ExplodeTree(Data=readstr_2.Results)  # -> Branch0, Branch1; disabled
panel_2 = Panel("self weight")  # disabled
panel_3 = Panel("SELF WEIGHT")  # disabled
panel_4 = Panel("1")  # disabled
panel_5 = Panel(bang.Branch1)  # disabled
nodaldisplacement_2 = NodalDisplacement(Result=bang.Branch0, CaseCombinationName=panel_3)  # -> CaseIdentifier, NodeId, Translation, Rotation; disabled
branch = TreeBranch(Tree=readstr_2.Results, Path=panel_4, MaintainPaths=True)  # disabled
panel_6 = Panel("self weight")  # disabled
pointsupportreaction = PointSupportReaction(Result=branch, CaseCombinationName=panel_6)  # -> CaseIdentifier, Identifier, NodeId, SupportPosition, ReactionForce, ReactionMoment, ForceResultant, MomentResultant; disabled

# ---- group: Finite Element from FEMDesign
data = Data(readstr.FdFeaModel)
femshell = FiniteElementFemShell(FiniteElement=data)  # -> Identifier, ElementId, FaceIndex, MeshGeometry
fembar = FiniteElementFemBar(FiniteElement=data)  # -> Identifier, ElementId, NodeI, NodeJ, LineGeometry
femnode = FiniteElementFemNode(FiniteElement=data)  # -> NodeId, Point

# ----
pointsupportreaction_2 = PointSupportReaction(Result=bang.Branch1, CaseCombinationName=panel_2)  # -> CaseIdentifier, Identifier, NodeId, SupportPosition, ReactionForce, ReactionMoment, ForceResultant, MomentResultant; disabled

int = Integer(femnode.NodeId)
geo = Geometry(femnode.Point)
geo_2 = Geometry(fembar.LineGeometry)
geo_3 = Geometry(femshell.MeshGeometry)

int_2 = Integer(nodaldisplacement.NodeId)
multiplication = Multiplication(A=nodaldisplacement.Translation, B=Slider(100, range=0..100))
keysearch = KeyValueSearch(Keys=int, Values=geo, Search=int_2)
move = Move(Geometry=keysearch, Motion=multiplication)  # -> Geometry, Transform
